# Dynamo graph VSCode.dyn (Dynamo 2.10.1.3976)

boolean = BoolSelector(true)
file_path = Filename(".\importFamily.py")
python_script = Python(IN[0]=boolean, IN[1]=file_path)  # IronPython2
# ---------- python_script.python (5 lines) ----------
re  = open(r"C:\Users\Desktop\Python\02_PyRevit\04_Processing\01_pyRevitAPI\02_Processing\importFamily.py", "r")

interpret = re.read()

OUT =  interpret
# ----------------------------------------
python_script_from_string = PythonStringNode(script=python_script)  # IronPython2; unwired: IN[0], IN[1]
boolean_2 = BoolSelector(true)  # frozen
python_script_2 = Python(IN[0]=boolean_2)  # IronPython2
# ---------- python_script_2.python (92 lines) ----------
"""Copyright by: vudinhduybm@gmail.com"""
#region ___import all Library
import clr
import sys 
import System   
import math
import collections

from math import cos,sin,tan,radians

clr.AddReference("ProtoGeometry")
from Autodesk.DesignScript.Geometry import *

clr.AddReference("RevitAPI") 
import Autodesk
from Autodesk.Revit.DB import* 
from Autodesk.Revit.DB.Structure import*

clr.AddReference("RevitAPIUI") 
from Autodesk.Revit.UI import*
from Autodesk.Revit.UI.Selection import ISelectionFilter
clr.AddReference("System") 
from System.Collections.Generic import List

clr.AddReference("RevitNodes")
import Revit
clr.ImportExtensions(Revit.Elements)
clr.ImportExtensions(Revit.GeometryConversion)

clr.AddReference("RevitServices")
import RevitServices
from RevitServices.Persistence import DocumentManager
from RevitServices.Transactions import TransactionManager

clr.AddReference("System.Windows.Forms")
clr.AddReference("System.Drawing")
clr.AddReference("System.Windows.Forms.DataVisualization")

import System.Windows.Forms 
from System.Windows.Forms import *
import System.Drawing
from System.Drawing import *
#endregion

#region ___Current doc/app/ui
doc = DocumentManager.Instance.CurrentDBDocument
uiapp = DocumentManager.Instance.CurrentUIApplication
app = uiapp.Application
uidoc = DocumentManager.Instance.CurrentUIApplication.ActiveUIDocument
view = doc.ActiveView
#endregion

#region ___someFunctions
def uwList(input):
    result = input if isinstance(input, list) else [input]
    return UnwrapElement(input)

def getAllPipeFittingsInPJ(doc):
    pipeFittingsName = []
    collector = FilteredElementCollector(doc).OfCategory(BuiltInCategory.OST_PipeFitting).WhereElementIsElementType().ToElements()
    for fitting in collector:
        # Use SYMBOL_NAME_PARAM to get the type name
        fittingNameParam = fitting.get_Parameter(BuiltInParameter.SYMBOL_NAME_PARAM)
        if fittingNameParam:
            fittingName = fittingNameParam.AsString()
            pipeFittingsName.append(fittingName)
    return collector, pipeFittingsName
def getAllPipeAccessoriesInPJ(doc):
    pipeFittingsName = []
    collector = FilteredElementCollector(doc).OfCategory(BuiltInCategory.OST_PipeAccessory).WhereElementIsElementType().ToElements()
    for fitting in collector:
        # Use SYMBOL_NAME_PARAM to get the type name
        fittingNameParam = fitting.get_Parameter(BuiltInParameter.SYMBOL_NAME_PARAM)
        if fittingNameParam:
            fittingName = fittingNameParam.AsString()
            pipeFittingsName.append(fittingName)
    return collector, pipeFittingsName    
def getAllGenericModelInPJ(doc):
    pipeFittingsName = []
    collector = FilteredElementCollector(doc).OfCategory(BuiltInCategory.OST_GenericModel).WhereElementIsElementType().ToElements()
    for fitting in collector:
        # Use SYMBOL_NAME_PARAM to get the type name
        fittingNameParam = fitting.get_Parameter(BuiltInParameter.SYMBOL_NAME_PARAM)
        if fittingNameParam:
            fittingName = fittingNameParam.AsString()
            pipeFittingsName.append(fittingName)
    return collector, pipeFittingsName      
#endregion



OUT =  getAllGenericModelInPJ(doc)
# ----------------------------------------
