# Dynamo graph VSCode.dyn (Dynamo 2.10.1.3976)

boolean = BoolSelector(true)
file_path = Filename(".\oppositeElbow_v2.py")
python_script = Python(IN[0]=boolean, IN[1]=file_path)  # IronPython2
# ---------- python_script.python (5 lines) ----------
re  = open(r"C:\Users\Desktop\Python\02_PyRevit\04_Processing\01_pyRevitAPI\oppositeElbow_v2.py", "r")

interpret = re.read()

OUT =  interpret
# ----------------------------------------
python_script_from_string = PythonStringNode(script=python_script)  # IronPython2; unwired: IN[0], IN[1]
