# Dynamo graph Template.dyn (Dynamo 2.10.1.3976)
# packages: Duynamo 2022.12.24, BIM3DM 2.1.9

# group: Select Model Elements
boolean = BoolSelector(true)
select_model_elements = Python(IN[0]=boolean)  # IronPython2; frozen
# ---------- select_model_elements.python (28 lines) ----------
import clr 
clr.AddReference("RevitAPI")
import Autodesk
from Autodesk.Revit.DB import *

clr.AddReference("RevitServices")
import RevitServices
from RevitServices.Persistence import DocumentManager

clr.AddReference("RevitAPIUI")
from Autodesk.Revit.UI import *

clr.AddReference("RevitNodes")
import Revit
clr.ImportExtensions(Revit.Elements)

doc = DocumentManager.Instance.CurrentDBDocument
uidoc=DocumentManager.Instance.CurrentUIApplication.ActiveUIDocument

obType = Selection.ObjectType.Element
ref =  uidoc.Selection.PickObjects(obType, "Please select model elements")

result = []
for ele in ref:
    elementsID = doc.GetElement(ele.ElementId)
    result.Add(elementsID.ToDSType)

OUT = result
# ----------------------------------------

# group: Select Model Element
boolean_2 = BoolSelector(true)
select_model_element = Python(IN[0]=boolean_2)  # IronPython2; frozen
# ---------- select_model_element.python (26 lines) ----------
import clr 
clr.AddReference("RevitAPI")
import Autodesk
from Autodesk.Revit.DB import *

clr.AddReference("RevitServices")
import RevitServices
from RevitServices.Persistence import DocumentManager

clr.AddReference("RevitAPIUI")
from Autodesk.Revit.UI import *

clr.AddReference("RevitNodes")
import Revit
clr.ImportExtensions(Revit.Elements)

doc = DocumentManager.Instance.CurrentDBDocument
uidoc=DocumentManager.Instance.CurrentUIApplication.ActiveUIDocument

obType = Selection.ObjectType.Element
ref =  uidoc.Selection.PickObject(obType, "Please select model element")

elementID = doc.GetElement(ref.ElementId)
element = elementID.ToDSType

OUT = element
# ----------------------------------------

# group: Get one Face and Line
boolean_3 = BoolSelector(true)
select_model_element_2 = Python(IN[0]=boolean_3)  # IronPython2; frozen
# ---------- select_model_element_2.python (38 lines) ----------
import clr 
import sys

import math
from System.Collections.Generic import *

clr.AddReference("ProtoGeometry")
from Autodesk.DesignScript.Geometry import *

clr.AddReference("RevitAPI")
import Autodesk
from Autodesk.Revit.DB import *

clr.AddReference("RevitAPIUI")
from Autodesk.Revit.UI import *
from Autodesk.Revit.UI.Selection import *

clr.AddReference("RevitNodes")
import Revit
clr.ImportExtensions(Revit.Elements)
clr.ImportExtensions(Revit.GeometryConversion)

clr.AddReference("RevitServices")
import RevitServices
from RevitServices.Persistence import DocumentManager
from RevitServices.Transactions import TransactionManager

doc = DocumentManager.Instance.CurrentDBDocument
view = doc.ActiveView
uidoc=DocumentManager.Instance.CurrentUIApplication.ActiveUIDocument

ref = uidoc.Selection.PickObject(ObjectType.Face, "Select One Face")
ele = uidoc.Document.GetElement(ref.ElementId)
retriEle = ele.GetGeometryObjectFromReference(ref)
getSurface = retriEle.ToProtoType()
getSurCuver = retriEle.GetEdgesAsCurveLoops()

OUT = getSurCuver
# ----------------------------------------
toprototype__level3 = Python(IN[1]=select_model_element_2)  # IronPython2; unwired: IN[0]
# ---------- toprototype__level3.python (34 lines) ----------
import clr 
import sys

import math
from System.Collections.Generic import *

clr.AddReference("ProtoGeometry")
from Autodesk.DesignScript.Geometry import *

clr.AddReference("RevitAPI")
import Autodesk
from Autodesk.Revit.DB import *

clr.AddReference("RevitAPIUI")
from Autodesk.Revit.UI import *
from Autodesk.Revit.UI.Selection import *

clr.AddReference("RevitNodes")
import Revit
clr.ImportExtensions(Revit.Elements)
clr.ImportExtensions(Revit.GeometryConversion)

clr.AddReference("RevitServices")
import RevitServices
from RevitServices.Persistence import DocumentManager
from RevitServices.Transactions import TransactionManager

element = UnwrapElement(IN[0])

doc = DocumentManager.Instance.CurrentDBDocument
view = doc.ActiveView
uidoc=DocumentManager.Instance.CurrentUIApplication.ActiveUIDocument

OUT = [j.ToProtoType() for i in IN[1] for j in i]
# ----------------------------------------

# group: Get Multi Face and Bounding line
boolean_4 = BoolSelector(true)
select_model_element_3 = Python(IN[0]=boolean_4)  # IronPython2; frozen
# ---------- select_model_element_3.python (41 lines) ----------
import clr 
import sys

import math
from System.Collections.Generic import *

clr.AddReference("ProtoGeometry")
from Autodesk.DesignScript.Geometry import *

clr.AddReference("RevitAPI")
import Autodesk
from Autodesk.Revit.DB import *

clr.AddReference("RevitAPIUI")
from Autodesk.Revit.UI import *
from Autodesk.Revit.UI.Selection import *

clr.AddReference("RevitNodes")
import Revit
clr.ImportExtensions(Revit.Elements)
clr.ImportExtensions(Revit.GeometryConversion)

clr.AddReference("RevitServices")
import RevitServices
from RevitServices.Persistence import DocumentManager
from RevitServices.Transactions import TransactionManager

doc = DocumentManager.Instance.CurrentDBDocument
view = doc.ActiveView
uidoc=DocumentManager.Instance.CurrentUIApplication.ActiveUIDocument

ref = uidoc.Selection.PickObjects(ObjectType.Face, "Select Multi Face")
result = []

for i in ref :
	ele = uidoc.Document.GetElement(i.ElementId)
	retriEle = ele.GetGeometryObjectFromReference(i)
	getSurface = retriEle.ToProtoType()
	getSurCuver = retriEle.GetEdgesAsCurveLoops()
	result.append(getSurCuver)
OUT = result
# ----------------------------------------
toprototype__level3_2 = Python(IN[1]=select_model_element_3)  # IronPython2; unwired: IN[0]
# ---------- toprototype__level3_2.python (34 lines) ----------
import clr 
import sys

import math
from System.Collections.Generic import *

clr.AddReference("ProtoGeometry")
from Autodesk.DesignScript.Geometry import *

clr.AddReference("RevitAPI")
import Autodesk
from Autodesk.Revit.DB import *

clr.AddReference("RevitAPIUI")
from Autodesk.Revit.UI import *
from Autodesk.Revit.UI.Selection import *

clr.AddReference("RevitNodes")
import Revit
clr.ImportExtensions(Revit.Elements)
clr.ImportExtensions(Revit.GeometryConversion)

clr.AddReference("RevitServices")
import RevitServices
from RevitServices.Persistence import DocumentManager
from RevitServices.Transactions import TransactionManager

element = UnwrapElement(IN[0])

doc = DocumentManager.Instance.CurrentDBDocument
view = doc.ActiveView
uidoc=DocumentManager.Instance.CurrentUIApplication.ActiveUIDocument

OUT = [k.ToProtoType() for i in IN[1] for j in i for k in j]
# ----------------------------------------

# group: Get Multi Face and Bounding line
boolean_5 = BoolSelector(false)
select_model_element_4 = Python(IN[0]=boolean_5)  # IronPython2; frozen
# ---------- select_model_element_4.python (64 lines) ----------
import clr 
import sys

import math
from System.Collections.Generic import *

clr.AddReference("ProtoGeometry")
from Autodesk.DesignScript.Geometry import *

clr.AddReference("RevitAPI")
import Autodesk
from Autodesk.Revit.DB import *

clr.AddReference("RevitAPIUI")
from Autodesk.Revit.UI import *
from Autodesk.Revit.UI.Selection import *

clr.AddReference("RevitNodes")
import Revit
clr.ImportExtensions(Revit.Elements)
clr.ImportExtensions(Revit.GeometryConversion)

clr.AddReference("RevitServices")
import RevitServices
from RevitServices.Persistence import DocumentManager
from RevitServices.Transactions import TransactionManager

doc = DocumentManager.Instance.CurrentDBDocument
view = doc.ActiveView
uidoc=DocumentManager.Instance.CurrentUIApplication.ActiveUIDocument


def getGeoElement(element): # Get geometry of element.
    geo = []
    opt = Options()
    geoByElement = element.get_Geometry(opt)
    geoEnum = geoByElement.GetEnumerator()
    geoEnum.MoveNext()
    geoNext = geoEnum.Current.GetInstanceGeometry()
    geo = [i for i in geoNext]
    out = []
    for i in geo:
    	if i.GetType()== Solid and i.Volume > 0:	
    		out.append(i)	
		if i.GetType() == GeometryInstance:	
			var = i.SymbolGeometry
			for j in var:
				if j.Volume > 0:
					out.append(i)
    return out


ref = uidoc.Selection.PickObjects(ObjectType.Face, "Select Multi Face")
result = []
lst = []

for i in ref :
	ele = uidoc.Document.GetElement(i.ElementId)
	geoFraming = getGeoElement(ele)

	result.append(geoFraming)
	

OUT = result
# ----------------------------------------

# group: IF by code block
code_block = CodeBlock()
# ---------- code_block.designscript (14 lines) ----------
def testIF(test, iftrue:var[]..[],iffalse:var[]..[])
{
return = [Imperative]
{
if(test)
{
return = iftrue;
}
else
{
return = iffalse;
}
}
};
# ----------------------------------------
code_block_2 = CodeBlock { testIF(test,iftrue,iffalse); }  # unwired: test, iftrue, iffalse

code_block_3 = CodeBlock { 0; }
if_code_block = CodeBlock(women=code_block_3)
# ---------- if_code_block.designscript (3 lines) ----------
(women==0)?0:
(women<=40?1:(women<=70?3:
(women<=100?4:(Maths.Round(((women-100)/40)+4)))));
# ----------------------------------------

# group: waitFor
wait_for = CodeBlock { [WaitFor,Pass][1]; }  # unwired: WaitFor, Pass

code_block_4 = CodeBlock { (10..200..20); }

# group: List Flatten
code_block_5 = CodeBlock { lst = [[1,2],[22,55],[111111,2,3,45,6,7,8]]; }
code_block_6 = CodeBlock(a=code_block_5) { a; }
code_block_7 = CodeBlock(x=code_block_6) { List.Flatten(x); }
flatten_by_import_dscorenodes = Python(IN[0]=code_block_5)  # "Flatten by import DSCoreNodes class"; IronPython2
# ---------- flatten_by_import_dscorenodes.python (46 lines) ----------
"""Copyright by: vudinhduybm@gmail.com"""
import clr 
import System
import math 
from System.Collections.Generic import *

clr.AddReference("ProtoGeometry")
from Autodesk.DesignScript.Geometry import *

clr.AddReference('RevitAPI')
import Autodesk
from Autodesk.Revit.DB import *

clr.AddReference('RevitAPIUI')
from Autodesk.Revit.UI import*
from  Autodesk.Revit.UI.Selection import*

clr.AddReference("RevitNodes")
import Revit
clr.ImportExtensions(Revit.Elements)
clr.ImportExtensions(Revit.GeometryConversion)

clr.AddReference("RevitServices")
import RevitServices
from RevitServices.Persistence import DocumentManager
from RevitServices.Transactions import TransactionManager

clr.AddReference("DSCoreNodes")
from DSCore.List import Flatten

doc = DocumentManager.Instance.CurrentDBDocument
view = doc.ActiveView
uidoc = DocumentManager.Instance.CurrentUIApplication.ActiveUIDocument

#Preparing input from dynamo to revit
element = UnwrapElement(IN[0])

#Do some action in a Transaction
TransactionManager.Instance.EnsureInTransaction(doc)
"""Now, You Can Code """



TransactionManager.Instance.TransactionTaskDone()

OUT = Flatten(IN[0])
# ----------------------------------------
flatten_by_hasattr_and = Python(IN[0]=code_block_5)  # "Flatten by hasattr and isinstance function"; IronPython2
# ---------- flatten_by_hasattr_and.python (51 lines) ----------
"""Copyright by: vudinhduybm@gmail.com"""
import clr 
import System
import math 
from System.Collections.Generic import *

clr.AddReference("ProtoGeometry")
from Autodesk.DesignScript.Geometry import *

clr.AddReference('RevitAPI')
import Autodesk
from Autodesk.Revit.DB import *

clr.AddReference('RevitAPIUI')
from Autodesk.Revit.UI import*
from  Autodesk.Revit.UI.Selection import*

clr.AddReference("RevitNodes")
import Revit
clr.ImportExtensions(Revit.Elements)
clr.ImportExtensions(Revit.GeometryConversion)

clr.AddReference("RevitServices")
import RevitServices
from RevitServices.Persistence import DocumentManager
from RevitServices.Transactions import TransactionManager

doc = DocumentManager.Instance.CurrentDBDocument
view = doc.ActiveView
uidoc = DocumentManager.Instance.CurrentUIApplication.ActiveUIDocument

#Preparing input from dynamo to revit
element = UnwrapElement(IN[0])

#Do some action in a Transaction
TransactionManager.Instance.EnsureInTransaction(doc)
"""Now, You Can Code """
def flatten(x):
    result = []
    try:
    	for el in x:
        	if hasattr(el, "__iter__") and not isinstance(el, basestring):
        	    result.extend(flatten(el))
        	else:
        	    result.append(el)
    except:
    	result = x
    return result

TransactionManager.Instance.TransactionTaskDone()
OUT = flatten(IN[0])
# ----------------------------------------
flatten_by_import_collections = Python(IN[0]=code_block_5)  # "Flatten by import collections class"; IronPython2
# ---------- flatten_by_import_collections.python (48 lines) ----------
"""Copyright by: vudinhduybm@gmail.com"""
import clr 
import System
import math 
from System.Collections.Generic import *

clr.AddReference("ProtoGeometry")
from Autodesk.DesignScript.Geometry import *

clr.AddReference('RevitAPI')
import Autodesk
from Autodesk.Revit.DB import *

clr.AddReference('RevitAPIUI')
from Autodesk.Revit.UI import*
from  Autodesk.Revit.UI.Selection import*

clr.AddReference("RevitNodes")
import Revit
clr.ImportExtensions(Revit.Elements)
clr.ImportExtensions(Revit.GeometryConversion)

clr.AddReference("RevitServices")
import RevitServices
from RevitServices.Persistence import DocumentManager
from RevitServices.Transactions import TransactionManager

import collections

doc = DocumentManager.Instance.CurrentDBDocument
view = doc.ActiveView
uidoc = DocumentManager.Instance.CurrentUIApplication.ActiveUIDocument

#Preparing input from dynamo to revit
element = UnwrapElement(IN[0])

#Do some action in a Transaction
TransactionManager.Instance.EnsureInTransaction(doc)
"""Now, You Can Code """

def flattenList(unflattened_list):
	if isinstance(unflattened_list,collections.Iterable):
		return [sub_element for element in unflattened_list for sub_element in flattenList(element)]
	else:
		return [unflattened_list]

TransactionManager.Instance.TransactionTaskDone()
OUT = flattenList(IN[0])
# ----------------------------------------

# group: Get Multi Face and Bounding line
boolean_6 = BoolSelector(false)
select_model_element_5 = Python(IN[0]=boolean_6)  # IronPython2; frozen
# ---------- select_model_element_5.python (87 lines) ----------
import clr 
import sys

import math
from System.Collections.Generic import *

clr.AddReference("ProtoGeometry")
from Autodesk.DesignScript.Geometry import *

clr.AddReference("RevitAPI")
import Autodesk
from Autodesk.Revit.DB import *

clr.AddReference("RevitAPIUI")
from Autodesk.Revit.UI import *
from Autodesk.Revit.UI.Selection import *

clr.AddReference("RevitNodes")
import Revit
clr.ImportExtensions(Revit.Elements)
clr.ImportExtensions(Revit.GeometryConversion)

clr.AddReference("RevitServices")
import RevitServices
from RevitServices.Persistence import DocumentManager
from RevitServices.Transactions import TransactionManager

doc = DocumentManager.Instance.CurrentDBDocument
view = doc.ActiveView
uidoc=DocumentManager.Instance.CurrentUIApplication.ActiveUIDocument


def getGeoElement(element): # Get geometry of element.
    geo = []
    opt = Options()
    geoByElement = element.get_Geometry(opt)
    geoEnum = geoByElement.GetEnumerator()
    geoEnum.MoveNext()
    geoNext = geoEnum.Current.GetInstanceGeometry()
    geo = [i for i in geoNext]
    out = []
    for i in geo:
    	if i.GetType()== Solid and i.Volume > 0:	
    		out.append(i)	
		if i.GetType() == GeometryInstance:	
			var = i.SymbolGeometry
			for j in var:
				if j.Volume > 0:
					out.append(i)
    return out

def getDBSolidFromGeo(lstGeo): # Get Solid from Geo
    sol = []
    for i in lstGeo:
        if type(i)== Autodesk.Revit.DB.Solid and i.Volume > 0:
            sol.append(i)
        elif type(i)== Autodesk.Revit.DB.GeometryInstance:
            var = i.SymbolGeometry
            for j in var:
                if type(j)== Autodesk.Revit.DB.Solid and j.Volume > 0:
                    sol.append(j)
        	sol.append(j)
    return sol
	
def getDBPlanarFormSolid(solids): # Get Planarface from solids
    plaf = []
    for i in solids:
        var = i.Faces
        for j in var:
            if j.Reference != None:
                plaf.append(j)
    return plaf

ref = uidoc.Selection.PickObjects(ObjectType.Face, "Select Multi Face")
result = []
lst = []

for i in ref :
	ele = uidoc.Document.GetElement(i.ElementId)
	getGeoFraming=[getGeoElement(ele) for i in ref]
	for j in getGeoFraming:
		getSolid = [getDBSolidFromGeo(j) for j in getGeoFraming]
		for t in getSolid:
			getPlane = [getDBPlanarFormSolid(t) for t in getSolid]
			result.append(getPlane)
	
OUT = result
# ----------------------------------------
toprototype__level3_3 = Python(IN[1]=select_model_element_5)  # IronPython2; unwired: IN[0]; same code as toprototype__level3_2

code_block_8 = CodeBlock { 100; 200; 0; 1; }
code_block_9 = CodeBlock(a=code_block_8.out0, b=code_block_8.out1) { a>b; }
logicIf = Custom[logicIf](Test=code_block_9, ifTrue=code_block_8.out3, ifFalse=code_block_8.out2)  # package Duynamo
code_block_10 = CodeBlock(a=logicIf) { a; }

# group: VS Code
boolean_7 = BoolSelector(false)  # frozen
python_script = Python(IN[0]=boolean_7)  # IronPython2
# ---------- python_script.python (5 lines) ----------
re  = open(r"A:\Library-Dynamo-Python-CSharp\test.py", "r")

interpret = re.read()

OUT =  interpret
# ----------------------------------------
python_script_from_string = PythonStringNode(script=python_script)  # IronPython2; unwired: IN[0], IN[1]

boolean_8 = BoolSelector(true)
pickObjects = Custom[pickObjects](Reset=boolean_8)  # frozen; package Duynamo; from Duynamo to pick Objects
getElementsDBSolid = Custom[getElementsDBSolid](element=pickObjects.element)  # package Duynamo; from Duynamo to retrive DBSolid of elements
getPlanarFromSolid = Custom[getPlanarFromSolid](DBSolid=getElementsDBSolid)  # package Duynamo; from Duynamo retrive Elements DBPlanar from DBSolid
conversionRtD = Custom[ConversionRtD](Objects=getPlanarFromSolid@L2)  # package BIM3DM; Return an object entity that can be displayed on the Dynamo interface.
flattenToLevel = Custom[FlattenToLevel](inputList=conversionRtD)  # package Duynamo; from Duynamo to Flatten input List to expected Level
boolean_9 = BoolSelector(false)  # frozen
pickMultiFaces = Custom[pickMultiFaces](Reset=boolean_9)  # package Duynamo; from Duynamo to select multi Faces
code_block_11 = CodeBlock(a=pickMultiFaces.element) { a; }
pickFaces = Python()  # IronPython2; frozen; unwired: IN[0]
# ---------- pickFaces.python (37 lines) ----------
"""Copyright by: vudinhduybm@gmail.com"""
import clr 
import System
import math 
from System.Collections.Generic import *

clr.AddReference("ProtoGeometry")
from Autodesk.DesignScript.Geometry import *

clr.AddReference('RevitAPI')
import Autodesk
from Autodesk.Revit.DB import *

clr.AddReference('RevitAPIUI')
from Autodesk.Revit.UI import*
from  Autodesk.Revit.UI.Selection import*

clr.AddReference("RevitNodes")
import Revit
clr.ImportExtensions(Revit.Elements)
clr.ImportExtensions(Revit.GeometryConversion)

clr.AddReference("RevitServices")
import RevitServices
from RevitServices.Persistence import DocumentManager
from RevitServices.Transactions import TransactionManager

doc = DocumentManager.Instance.CurrentDBDocument
view = doc.ActiveView
uidoc = DocumentManager.Instance.CurrentUIApplication.ActiveUIDocument

def pickObjects():
    from Autodesk.Revit.UI.Selection import ObjectType
    refs = uidoc.Selection.PickObjects(ObjectType.Face, "Please select the Desired Faces")
    return  [doc.GetElement(i.ElementId) for i in refs], [ref for ref in refs]

OUT = pickObjects()
# ----------------------------------------
code_block_12 = CodeBlock(a=pickFaces) { a[1]; }
code_block_13 = CodeBlock { a[0]; a[1]; a[2]; }  # unwired: a
code_block_14 = CodeBlock(x=code_block_13.out1) { x; }
code_block_15 = CodeBlock(DynamoXYZ=code_block_13.out0) { DynamoXYZ; }
code_block_16 = CodeBlock(revitPointsInMillimeterUnit=code_block_13.out1) { revitPointsInMillimeterUnit; }
code_block_17 = CodeBlock(x=code_block_13.out2) { x; }
code_block_18 = CodeBlock()
# ---------- code_block_18.designscript (2 lines) ----------
//String Input Req
"Please pick points";
# ----------------------------------------
code_block_19 = CodeBlock { Reset: bool = false; }

# group: pick Points
boolean_10 = BoolSelector(true)  # frozen
pickPoints = Custom[pickPoints](Reset=boolean_10)  # package Duynamo; from Duynamo. pick Point in current Workplane and retrive Revit Points in Millimeter unit
code_block_20 = CodeBlock(a=pickPoints.revitPointsInMillimeterUnit) { a; }

pickEdges = Python()  # IronPython2; frozen; unwired: IN[0]
# ---------- pickEdges.python (41 lines) ----------
"""Copyright by: vudinhduybm@gmail.com"""
import clr 
import System
import math 
from System.Collections.Generic import *

clr.AddReference("ProtoGeometry")
from Autodesk.DesignScript.Geometry import *

clr.AddReference('RevitAPI')
import Autodesk
from Autodesk.Revit.DB import *

clr.AddReference('RevitAPIUI')
from Autodesk.Revit.UI import*
from  Autodesk.Revit.UI.Selection import*
from Autodesk.Revit.UI.Selection import ObjectType

clr.AddReference("RevitNodes")
import Revit
clr.ImportExtensions(Revit.Elements)
clr.ImportExtensions(Revit.GeometryConversion)

clr.AddReference("RevitServices")
import RevitServices
from RevitServices.Persistence import DocumentManager
from RevitServices.Transactions import TransactionManager

doc = DocumentManager.Instance.CurrentDBDocument
view = doc.ActiveView
uidoc = DocumentManager.Instance.CurrentUIApplication.ActiveUIDocument

def pickObjects():
    elements = []
    refs = uidoc.Selection.PickObjects(Autodesk.Revit.UI.Selection.ObjectType.Edge, "Please select the Desired Edges")
    for i in refs:
        ele = doc.GetElement(i.ElementId)
        elements.append(ele)
    return  refs, elements

OUT = pickObjects()
# ----------------------------------------
pickEdges_2 = Custom[pickEdges]()  # frozen; package Duynamo; from Duynamo to select desired Edges
code_block_21 = CodeBlock(a=pickEdges_2.reference) { a; }
code_block_22 = CodeBlock(a=pickEdges_2.element) { a; }
code_block_23 = CodeBlock { a; }  # unwired: a
pickMultiFaces_2 = Custom[pickMultiFaces]()  # frozen
code_block_24 = CodeBlock(a=pickMultiFaces_2.element) { a; }
boolean_11 = BoolSelector(true)  # frozen
pickEdges_3 = Python(IN[0]=boolean_11)  # IronPython2; frozen
# ---------- pickEdges_3.python (45 lines) ----------
"""Copyright by: vudinhduybm@gmail.com"""
import clr 
import System
import math 
from System.Collections.Generic import *

clr.AddReference("ProtoGeometry")
from Autodesk.DesignScript.Geometry import *

clr.AddReference('RevitAPI')
import Autodesk
from Autodesk.Revit.DB import *

clr.AddReference('RevitAPIUI')
from Autodesk.Revit.UI import*
from  Autodesk.Revit.UI.Selection import*

clr.AddReference("RevitNodes")
import Revit
clr.ImportExtensions(Revit.Elements)
clr.ImportExtensions(Revit.GeometryConversion)

clr.AddReference("RevitServices")
import RevitServices
from RevitServices.Persistence import DocumentManager
from RevitServices.Transactions import TransactionManager

doc = DocumentManager.Instance.CurrentDBDocument
view = doc.ActiveView
uidoc = DocumentManager.Instance.CurrentUIApplication.ActiveUIDocument

def pickObjects():
    edges = []
    elements = []
    refs = uidoc.Selection.PickObjects(Autodesk.Revit.UI.Selection.ObjectType.Edge, "Please select the Desired Edges")
    #GeoObs = doc.GetElement(refs).GetGeometryObjectFromReference(refs)
    for i in refs:
        ele = doc.GetElement(i.ElementId)
        elements.append(ele)
        edge = ele.GetGeometryObjectFromReference(i)
        edges.append(edge.AsCurve().ToProtoType())
        
    return  edges, elements

OUT = pickObjects()
# ----------------------------------------
code_block_25 = CodeBlock(a=pickEdges_3) { a[1]; }
retrive_all_edges_of_element = Python(IN[0]=code_block_25)  # IronPython2; frozen
# ---------- retrive_all_edges_of_element.python (68 lines) ----------
"""Copyright by: vudinhduybm@gmail.com"""
import clr 
import System
import math 
from System.Collections.Generic import *

clr.AddReference("ProtoGeometry")
from Autodesk.DesignScript.Geometry import *

clr.AddReference('RevitAPI')
import Autodesk
from Autodesk.Revit.DB import *

clr.AddReference('RevitAPIUI')
from Autodesk.Revit.UI import*
from  Autodesk.Revit.UI.Selection import*

clr.AddReference("RevitNodes")
import Revit
clr.ImportExtensions(Revit.Elements)
clr.ImportExtensions(Revit.GeometryConversion)

clr.AddReference("RevitServices")
import RevitServices
from RevitServices.Persistence import DocumentManager
from RevitServices.Transactions import TransactionManager

clr.AddReference("DSCoreNodes")
from DSCore.List import Flatten

doc = DocumentManager.Instance.CurrentDBDocument
view = doc.ActiveView
uidoc = DocumentManager.Instance.CurrentUIApplication.ActiveUIDocument

#Preparing input from dynamo to revit
def getGeoElement(element): # Get geometry of element.
    geo = []
    opt = Options()
    geoByElement = element.get_Geometry(opt)
    geoEnum = geoByElement.GetEnumerator() 
    geoEnum.MoveNext()
    geoNext = geoEnum.Current.GetInstanceGeometry()
    geo = [i for i in geoNext]
    out = []
    for i in geo:
    	if i.GetType()== Solid and i.Volume > 0:
            edges = i.Edges
            for edge in edges:			
                out.append(edge)	
        if i.GetType() == GeometryInstance:	
            var = i.SymbolGeometry
            for j in var:
                if j.Volume > 0:
                    edges = j.Edges
                    for edge in edges:
                        out.append(edge)
    return out


lstEle = UnwrapElement(IN[0])
if isinstance(lstEle,list):
    elements = UnwrapElement(lstEle)
else:
    elements = [UnwrapElement(lstEle)]
    
lst = [getGeoElement(i) for j in elements for i in j]
        
OUT = lst
# ----------------------------------------
code_block_26 = CodeBlock(a=pickEdges_3) { a[0]; }
retrive_all_edges_of_element_2 = Python(IN[0]=code_block_25)  # IronPython2; frozen
# ---------- retrive_all_edges_of_element_2.python (68 lines) ----------
"""Copyright by: vudinhduybm@gmail.com"""
import clr 
import System
import math 
from System.Collections.Generic import *

clr.AddReference("ProtoGeometry")
from Autodesk.DesignScript.Geometry import *

clr.AddReference('RevitAPI')
import Autodesk
from Autodesk.Revit.DB import *

clr.AddReference('RevitAPIUI')
from Autodesk.Revit.UI import*
from  Autodesk.Revit.UI.Selection import*

clr.AddReference("RevitNodes")
import Revit
clr.ImportExtensions(Revit.Elements)
clr.ImportExtensions(Revit.GeometryConversion)

clr.AddReference("RevitServices")
import RevitServices
from RevitServices.Persistence import DocumentManager
from RevitServices.Transactions import TransactionManager

clr.AddReference("DSCoreNodes")
from DSCore.List import Flatten

doc = DocumentManager.Instance.CurrentDBDocument
view = doc.ActiveView
uidoc = DocumentManager.Instance.CurrentUIApplication.ActiveUIDocument

#Preparing input from dynamo to revit
def getGeoElement(references): # Get geometry of element.
    geo = []
    opt = Options()
    geoByElement = references.get_Geometry(opt)
    geoEnum = geoByElement.GetEnumerator() 
    geoEnum.MoveNext()
    geoNext = geoEnum.Current.GetInstanceGeometry()
    geo = [i for i in geoNext]
    out = []
    for i in geo:
    	if i.GetType()== Solid and i.Volume > 0:
            edges = i.Edges
            for edge in edges:			
                out.append(edge)	
        if i.GetType() == GeometryInstance:	
            var = i.SymbolGeometry
            for j in var:
                if j.Volume > 0:
                    edges = j.Edges
                    for edge in edges:
                        out.append(edge)
    return out


lstEle = UnwrapElement(IN[0])
if isinstance(lstEle,list):
    elements = UnwrapElement(lstEle)
else:
    elements = [UnwrapElement(lstEle)]
    
lst = [getGeoElement(i) for j in elements for i in j]
        
OUT = lst
# ----------------------------------------
boolean_12 = BoolSelector(false)
pickFaces_2 = Python(IN[0]=boolean_12)  # IronPython2
# ---------- pickFaces_2.python (45 lines) ----------
"""Copyright by: vudinhduybm@gmail.com"""
import clr 
import System
import math 
from System.Collections.Generic import *

clr.AddReference("ProtoGeometry")
from Autodesk.DesignScript.Geometry import *

clr.AddReference('RevitAPI')
import Autodesk
from Autodesk.Revit.DB import *

clr.AddReference('RevitAPIUI')
from Autodesk.Revit.UI import*
from  Autodesk.Revit.UI.Selection import*

clr.AddReference("RevitNodes")
import Revit
clr.ImportExtensions(Revit.Elements)
clr.ImportExtensions(Revit.GeometryConversion)

clr.AddReference("RevitServices")
import RevitServices
from RevitServices.Persistence import DocumentManager
from RevitServices.Transactions import TransactionManager

doc = DocumentManager.Instance.CurrentDBDocument
view = doc.ActiveView
uidoc = DocumentManager.Instance.CurrentUIApplication.ActiveUIDocument

def pickObjects():
    faces = []
    elements = []
    refs = uidoc.Selection.PickObjects(Autodesk.Revit.UI.Selection.ObjectType.Face, "Please select the Desired Faces")
    #GeoObs = doc.GetElement(refs).GetGeometryObjectFromReference(refs)
    for i in refs:
        ele = doc.GetElement(i.ElementId)
        elements.append(ele)
        face = ele.GetGeometryObjectFromReference(i)
        faces.append(face.ToProtoType())
        
    return  faces, elements

OUT = pickObjects()
# ----------------------------------------
code_block_27 = CodeBlock(a=pickFaces_2) { a[1]; }
code_block_28 = CodeBlock(a=pickFaces_2) { a[0]; }
retrive_all_faces_of_element = Python(IN[0]=code_block_28)  # IronPython2
# ---------- retrive_all_faces_of_element.python (62 lines) ----------
"""Copyright by: vudinhduybm@gmail.com"""
import clr 
import System
import math 
from System.Collections.Generic import *

clr.AddReference("ProtoGeometry")
from Autodesk.DesignScript.Geometry import *

clr.AddReference('RevitAPI')
import Autodesk
from Autodesk.Revit.DB import *

clr.AddReference('RevitAPIUI')
from Autodesk.Revit.UI import*
from  Autodesk.Revit.UI.Selection import*

clr.AddReference("RevitNodes")
import Revit
clr.ImportExtensions(Revit.Elements)
clr.ImportExtensions(Revit.GeometryConversion)

clr.AddReference("RevitServices")
import RevitServices
from RevitServices.Persistence import DocumentManager
from RevitServices.Transactions import TransactionManager

clr.AddReference("DSCoreNodes")
from DSCore.List import Flatten

doc = DocumentManager.Instance.CurrentDBDocument
view = doc.ActiveView
uidoc = DocumentManager.Instance.CurrentUIApplication.ActiveUIDocument

#Preparing input from dynamo to revit
def getGeoElement(faceList): # Get geometry of element.
    geo = []
    opt = Options()
    geoByElement = faceList.get_Geometry(opt)
    geoEnum = geoByElement.GetEnumerator() 
    geoEnum.MoveNext()
    geoNext = geoEnum.Current.GetInstanceGeometry()
    geo = [i for i in geoNext]
    out = []
    for i in geo:
    	if i.GetType()== Face:
    		out.append(i)	
        if i.GetType() == GeometryInstance:	
            var = i.SymbolGeometry
            out.append(var)
    return out


lstEle = UnwrapElement(IN[0])
if isinstance(lstEle,list):
    elements = UnwrapElement(lstEle)
else:
    elements = [UnwrapElement(lstEle)]
    
lst = [getGeoElement(i) for j in elements for i in j]
        
OUT = lst
# ----------------------------------------
DBLineByGeometry = Custom[DBLineByGeometry]()  # package BIM3DM; Extract actual Autodesk.Revit.DB.Line from Geometries.; unwired: DBGeometry
python_script_2 = Python()  # IronPython2; unwired: IN[0]
# ---------- python_script_2.python (60 lines) ----------
"""Copyright by: vudinhduybm@gmail.com"""
import clr 

import System
from System import Array
from System.Collections.Generic import *

clr.AddReference("ProtoGeometry")
from Autodesk.DesignScript.Geometry import *

clr.AddReference("RevitNodes")
import Revit
clr.ImportExtensions(Revit.Elements)
clr.ImportExtensions(Revit.GeometryConversion)

clr.AddReference("RevitServices")
import RevitServices
from RevitServices.Persistence import DocumentManager
from RevitServices.Transactions import TransactionManager

clr.AddReference('RevitAPI')
clr.AddReference('RevitAPIUI')

import Autodesk
from Autodesk.Revit.DB import MEPCurve
from Autodesk.Revit.UI import*
from Autodesk.Revit.UI.Selection import*

#Current doc/app/ui
doc = DocumentManager.Instance.CurrentDBDocument
uiapp = DocumentManager.Instance.CurrentUIApplication
app = uiapp.Application
uidoc = DocumentManager.Instance.CurrentUIApplication.ActiveUIDocument
view = doc.ActiveView

#Define list/unwrap list functions
def toList(inList):
    result = inList if isinstance(inList, list) else [inList]
    return result

def dList(inList):
    result = inList if isinstance(inList, list) else [inList]
    return UnwrapElement(result)

# preparing input for dynamo to revit
element   = IN[0]

# Do some action in a Transaction
TransactionManager.Instance.EnsureInTransaction(doc)

# Now do something here

TransactionManager.Instance.TransactionTaskDone()

# Output and Changing element to Dynamo for export
# <element>.ToDSType(True), #Not created in script, mark as Revit-owned
# <element>.ToDSType(False) #Created in script, mark as non-Revit-owned

# Output to Dynamo
OUT = dir(MEPCurve)
# ----------------------------------------
python_script_3 = Python()  # IronPython2; unwired: IN[0]
# ---------- python_script_3.python (62 lines) ----------
"""Copyright by: vudinhduybm@gmail.com"""
import clr 

import System
from System import Array
from System.Collections.Generic import *

clr.AddReference("ProtoGeometry")
from Autodesk.DesignScript.Geometry import *

clr.AddReference("RevitNodes")
import Revit
clr.ImportExtensions(Revit.Elements)
clr.ImportExtensions(Revit.GeometryConversion)

clr.AddReference("RevitServices")
import RevitServices
from RevitServices.Persistence import DocumentManager
from RevitServices.Transactions import TransactionManager

clr.AddReference('RevitAPI')
clr.AddReference('RevitAPIUI')

import Autodesk
from Autodesk.Revit.DB import*
from Autodesk.Revit.UI import*
from Autodesk.Revit.UI.Selection import*

#Current doc/app/ui
doc = DocumentManager.Instance.CurrentDBDocument
uiapp = DocumentManager.Instance.CurrentUIApplication
app = uiapp.Application
uidoc = DocumentManager.Instance.CurrentUIApplication.ActiveUIDocument
view = doc.ActiveView

#Define list/unwrap list functions
def toList(inList):
    result = inList if isinstance(inList, list) else [inList]
    return result

def dList(inList):
    result = inList if isinstance(inList, list) else [inList]
    return UnwrapElement(result)

# preparing input for dynamo to revit
element   = IN[0]
elements  = toList(IN[0])
d_List    = dList(IN[0]) 

# Do some action in a Transaction
TransactionManager.Instance.EnsureInTransaction(doc)

# Now do something here

TransactionManager.Instance.TransactionTaskDone()

# Output and Changing element to Dynamo for export
# <element>.ToDSType(True), #Not created in script, mark as Revit-owned
# <element>.ToDSType(False) #Created in script, mark as non-Revit-owned

# Output to Dynamo
OUT = MEPCurve.__doc__, Vector.ByTwoPoints.__doc__,Wall.__doc__
# ----------------------------------------
wait_for_2 = CodeBlock { [WaitFor,Pass][1]; }  # unwired: WaitFor, Pass
pickEdges1 = Python(IN[0]=boolean_11)  # IronPython2
# ---------- pickEdges1.python (45 lines) ----------
"""Copyright by: vudinhduybm@gmail.com"""
import clr 
import System
import math 
from System.Collections.Generic import *

clr.AddReference("ProtoGeometry")
from Autodesk.DesignScript.Geometry import *

clr.AddReference('RevitAPI')
import Autodesk
from Autodesk.Revit.DB import *

clr.AddReference('RevitAPIUI')
from Autodesk.Revit.UI import*
from  Autodesk.Revit.UI.Selection import*

clr.AddReference("RevitNodes")
import Revit
clr.ImportExtensions(Revit.Elements)
clr.ImportExtensions(Revit.GeometryConversion)

clr.AddReference("RevitServices")
import RevitServices
from RevitServices.Persistence import DocumentManager
from RevitServices.Transactions import TransactionManager

doc = DocumentManager.Instance.CurrentDBDocument
view = doc.ActiveView
uidoc = DocumentManager.Instance.CurrentUIApplication.ActiveUIDocument

def pickObjects():
    edges = []
    elements = []
    refs = uidoc.Selection.PickObjects(Autodesk.Revit.UI.Selection.ObjectType.Edge, "Please select the Desired Edges")
    #GeoObs = doc.GetElement(refs).GetGeometryObjectFromReference(refs)
    for i in range(len(refs)):
        ele = doc.GetElement(refs[i].ElementId)
        elements.append(ele)
        edge = ele.GetGeometryObjectFromReference(refs[i])
        edges.append(edge.AsCurve().ToProtoType())
        
    return  edges, elements

OUT = pickObjects()
# ----------------------------------------
