# Dynamo graph PipeCreate.dyn (Dynamo 2.10.1.3976)
# packages: Duynamo 2022.12.24

boolean = BoolSelector(false)  # frozen
file_path = Filename("..\PipeCreate.py")
python_script = Python(IN[0]=boolean, IN[1]=file_path)  # IronPython2
# ---------- python_script.python (5 lines) ----------
re  = open(r"C:\Users\95053\Desktop\Python\RevitAPI-master\RevitAPI\PipeCreate.py", "r")

interpret = re.read()

OUT =  interpret
# ----------------------------------------
python_script_from_string = PythonStringNode(script=python_script)  # IronPython2; unwired: IN[0]
boolean_2 = BoolSelector(false)  # frozen
file_path_2 = Filename("..\clickButton.py")
python_script_2 = Python(IN[0]=boolean_2, IN[1]=file_path_2)  # IronPython2
# ---------- python_script_2.python (5 lines) ----------
re  = open(r"C:\Users\95053\Desktop\Python\RevitAPI-master\RevitAPI\\clickButton.py", "r")

interpret = re.read()

OUT =  interpret
# ----------------------------------------
python_script_from_string_2 = PythonStringNode(script=python_script_2)  # IronPython2; unwired: IN[0]
python_script_3 = Python()  # IronPython2; frozen; unwired: IN[0]
# ---------- python_script_3.python (345 lines) ----------
import clr
import sys 
import System   
clr.AddReference("ProtoGeometry")
from Autodesk.DesignScript.Geometry import *

clr.AddReference("RevitAPI") 
from Autodesk.Revit.DB import*
from Autodesk.Revit.DB.Structure import*

clr.AddReference("RevitAPIUI") 
from Autodesk.Revit.UI import*

clr.AddReference("System") 
from System.Collections.Generic import List

clr.AddReference("RevitNodes")
import Revit
clr.ImportExtensions(Revit.Elements)
clr.ImportExtensions(Revit.GeometryConversion)

clr.AddReference("RevitServices")
import RevitServices
from RevitServices.Persistence import DocumentManager
from RevitServices.Transactions import TransactionManager

clr.AddReference("System.Windows.Forms")
clr.AddReference("System.Drawing")
clr.AddReference("System.Windows.Forms.DataVisualization")

import System.Windows.Forms 
from System.Windows.Forms import *
import System.Drawing
from System.Drawing import *


doc = DocumentManager.Instance.CurrentDBDocument
uiapp = DocumentManager.Instance.CurrentUIApplication
app = uiapp.Application
uidoc = DocumentManager.Instance.CurrentUIApplication.ActiveUIDocument
view = doc.ActiveView



def getAllPipingSystems(doc):
	collector = FilteredElementCollector(doc, view.Id).OfCategory(BuiltInCategory.OST_PipingSystem)
	pipingSystems = collector.ToElements()
	pipingSystemsName = []
	for system in pipingSystems:
		systemName = system.get_Parameter(BuiltInParameter.SYMBOL_NAME_PARAM).AsString()
		pipingSystemsName.append(systemName)
	return pipingSystemsName

pipingSystemsCollector = getAllPipingSystems(doc)

def getAllPipeTypes(doc):
	collector1 = FilteredElementCollector(doc, view.Id).OfCategory(BuiltInCategory.OST_PipeCurves)
	pipeTypes = collector1.ToElements()
	pipeTypesName = []
	for pipeType in pipeTypes:
		pipeTypeName = pipeType.get_Parameter(BuiltInParameter.SYMBOL_NAME_PARAM).AsString()
		pipeTypesName.append(pipeTypeName)
	return pipeTypesName

pipeTypesCollector = getAllPipeTypes(doc)

levelsCollector = FilteredElementCollector(doc).OfClass(Level).ToElements()
levelsNameCollector = []
for level in levelsCollector:
	levelName = level.Name
	levelsNameCollector.append(levelName)

class MainForm(Form):
	def __init__(self):
		self.InitializeComponent()
	
	def InitializeComponent(self):
		self._groupBox1 = System.Windows.Forms.GroupBox()
		self._button1 = System.Windows.Forms.Button()
		self._button2 = System.Windows.Forms.Button()
		self._comboBox1 = System.Windows.Forms.ComboBox()
		self._label1 = System.Windows.Forms.Label()
		self._groupBox2 = System.Windows.Forms.GroupBox()
		self._label2 = System.Windows.Forms.Label()
		self._comboBox2 = System.Windows.Forms.ComboBox()
		self._groupBox3 = System.Windows.Forms.GroupBox()
		self._label3 = System.Windows.Forms.Label()
		self._comboBox3 = System.Windows.Forms.ComboBox()
		self._groupBox4 = System.Windows.Forms.GroupBox()
		self._label4 = System.Windows.Forms.Label()
		self._textBox1 = System.Windows.Forms.TextBox()
		self._button3 = System.Windows.Forms.Button()
		self._button4 = System.Windows.Forms.Button()
		self._label5 = System.Windows.Forms.Label()
		self._groupBox1.SuspendLayout()
		self._groupBox2.SuspendLayout()
		self._groupBox3.SuspendLayout()
		self._groupBox4.SuspendLayout()
		self.SuspendLayout()
		# 
		# groupBox1
		# 
		self._groupBox1.Controls.Add(self._label1)
		self._groupBox1.Controls.Add(self._comboBox1)
		self._groupBox1.Location = System.Drawing.Point(12, 159)
		self._groupBox1.Name = "groupBox1"
		self._groupBox1.Size = System.Drawing.Size(449, 47)
		self._groupBox1.TabIndex = 0
		self._groupBox1.TabStop = False
		# 
		# button1
		# 
		self._button1.BackColor = System.Drawing.SystemColors.Info
		self._button1.Font = System.Drawing.Font("MS UI Gothic", 10, System.Drawing.FontStyle.Bold | System.Drawing.FontStyle.Underline, System.Drawing.GraphicsUnit.Point, 128, True)
		self._button1.ForeColor = System.Drawing.Color.Red
		self._button1.Location = System.Drawing.Point(52, 28)
		self._button1.Name = "button1"
		self._button1.Size = System.Drawing.Size(140, 58)
		self._button1.TabIndex = 1
		self._button1.Text = "get X,Y value"
		self._button1.UseVisualStyleBackColor = False
		# 
		# button2
		# 
		self._button2.BackColor = System.Drawing.SystemColors.Info
		self._button2.Cursor = System.Windows.Forms.Cursors.AppStarting
		self._button2.Font = System.Drawing.Font("MS UI Gothic", 10, System.Drawing.FontStyle.Bold | System.Drawing.FontStyle.Underline, System.Drawing.GraphicsUnit.Point, 128, True)
		self._button2.ForeColor = System.Drawing.Color.Red
		self._button2.Location = System.Drawing.Point(279, 28)
		self._button2.Name = "button2"
		self._button2.Size = System.Drawing.Size(140, 58)
		self._button2.TabIndex = 2
		self._button2.Text = "get Z value"
		self._button2.UseVisualStyleBackColor = False
		# 
		# comboBox1
		# 
		self._comboBox1.AllowDrop = True
		self._comboBox1.Cursor = System.Windows.Forms.Cursors.AppStarting
		self._comboBox1.FormattingEnabled = True
		self._comboBox1.Location = System.Drawing.Point(180, 12)
		self._comboBox1.Name = "comboBox1"
		self._comboBox1.Size = System.Drawing.Size(263, 23)
		self._comboBox1.TabIndex = 3
		self._comboBox1.SelectedIndexChanged += self.ComboBox1_SelectedIndexChanged
		self._comboBox1.Items.AddRange(System.Array[System.Object](pipingSystemsCollector))

		# 
		# label1
		# 
		self._label1.BackColor = System.Drawing.SystemColors.Info
		self._label1.BorderStyle = System.Windows.Forms.BorderStyle.Fixed3D
		self._label1.Font = System.Drawing.Font("MS UI Gothic", 9, System.Drawing.FontStyle.Bold, System.Drawing.GraphicsUnit.Point, 128)
		self._label1.ForeColor = System.Drawing.Color.Blue
		self._label1.Location = System.Drawing.Point(19, 12)
		self._label1.Name = "label1"
		self._label1.Size = System.Drawing.Size(142, 23)
		self._label1.TabIndex = 4
		self._label1.Text = "PipingSystemType"
		# 
		# groupBox2
		# 
		self._groupBox2.Controls.Add(self._label2)
		self._groupBox2.Controls.Add(self._comboBox2)
		self._groupBox2.Location = System.Drawing.Point(12, 212)
		self._groupBox2.Name = "groupBox2"
		self._groupBox2.Size = System.Drawing.Size(449, 47)
		self._groupBox2.TabIndex = 5
		self._groupBox2.TabStop = False
		# 
		# label2
		# 
		self._label2.BackColor = System.Drawing.SystemColors.Info
		self._label2.BorderStyle = System.Windows.Forms.BorderStyle.Fixed3D
		self._label2.Font = System.Drawing.Font("MS UI Gothic", 9, System.Drawing.FontStyle.Bold, System.Drawing.GraphicsUnit.Point, 128)
		self._label2.ForeColor = System.Drawing.Color.Blue
		self._label2.Location = System.Drawing.Point(19, 12)
		self._label2.Name = "label2"
		self._label2.Size = System.Drawing.Size(142, 23)
		self._label2.TabIndex = 4
		self._label2.Text = "PipeType"
		self._label2.Click += self.Label2Click
		# 
		# comboBox2
		# 
		self._comboBox2.AllowDrop = True
		self._comboBox2.Cursor = System.Windows.Forms.Cursors.AppStarting
		self._comboBox2.FormattingEnabled = True
		self._comboBox2.Location = System.Drawing.Point(180, 12)
		self._comboBox2.Name = "comboBox2"
		self._comboBox2.Size = System.Drawing.Size(263, 23)
		self._comboBox2.TabIndex = 3
		self._comboBox2.SelectedIndexChanged += self.ComboBox2_SelectedIndexChanged
		self._comboBox2.Items.AddRange(System.Array[System.Object](pipeTypesCollector))		
		# 
		# groupBox3
		# 
		self._groupBox3.Controls.Add(self._label3)
		self._groupBox3.Controls.Add(self._comboBox3)
		self._groupBox3.Location = System.Drawing.Point(12, 265)
		self._groupBox3.Name = "groupBox3"
		self._groupBox3.Size = System.Drawing.Size(449, 47)
		self._groupBox3.TabIndex = 6
		self._groupBox3.TabStop = False
		# 
		# label3
		# 
		self._label3.BackColor = System.Drawing.SystemColors.Info
		self._label3.BorderStyle = System.Windows.Forms.BorderStyle.Fixed3D
		self._label3.Font = System.Drawing.Font("MS UI Gothic", 9, System.Drawing.FontStyle.Bold, System.Drawing.GraphicsUnit.Point, 128)
		self._label3.ForeColor = System.Drawing.Color.Blue
		self._label3.Location = System.Drawing.Point(19, 12)
		self._label3.Name = "label3"
		self._label3.Size = System.Drawing.Size(142, 23)
		self._label3.TabIndex = 4
		self._label3.Text = "RefLevel"
		# 
		# comboBox3
		# 
		self._comboBox3.AllowDrop = True
		self._comboBox3.Cursor = System.Windows.Forms.Cursors.AppStarting
		self._comboBox3.FormattingEnabled = True
		self._comboBox3.Location = System.Drawing.Point(180, 12)
		self._comboBox3.Name = "comboBox3"
		self._comboBox3.Size = System.Drawing.Size(263, 23)
		self._comboBox3.TabIndex = 3
		self._comboBox3.SelectedIndexChanged += self.ComboBox3_SelectedIndexChanged
		self._comboBox3.Items.AddRange(System.Array[System.Object](levelsNameCollector))			
		# 
		# groupBox4
		# 
		self._groupBox4.Controls.Add(self._textBox1)
		self._groupBox4.Controls.Add(self._label4)
		self._groupBox4.Location = System.Drawing.Point(12, 318)
		self._groupBox4.Name = "groupBox4"
		self._groupBox4.Size = System.Drawing.Size(449, 47)
		self._groupBox4.TabIndex = 7
		self._groupBox4.TabStop = False
		# 
		# label4
		# 
		self._label4.BackColor = System.Drawing.SystemColors.Info
		self._label4.BorderStyle = System.Windows.Forms.BorderStyle.Fixed3D
		self._label4.Font = System.Drawing.Font("MS UI Gothic", 9, System.Drawing.FontStyle.Bold, System.Drawing.GraphicsUnit.Point, 128)
		self._label4.ForeColor = System.Drawing.Color.Blue
		self._label4.Location = System.Drawing.Point(19, 12)
		self._label4.Name = "label4"
		self._label4.Size = System.Drawing.Size(142, 23)
		self._label4.TabIndex = 4
		self._label4.Text = "Diameter"
		# 
		# textBox1
		# 
		self._textBox1.Location = System.Drawing.Point(180, 12)
		self._textBox1.Name = "textBox1"
		self._textBox1.Size = System.Drawing.Size(263, 22)
		self._textBox1.TabIndex = 5
		# 
		# button3
		# 
		self._button3.BackColor = System.Drawing.SystemColors.ScrollBar
		self._button3.Cursor = System.Windows.Forms.Cursors.WaitCursor
		self._button3.Font = System.Drawing.Font("MS UI Gothic", 10, System.Drawing.FontStyle.Bold, System.Drawing.GraphicsUnit.Point, 128, True)
		self._button3.ForeColor = System.Drawing.Color.Red
		self._button3.Location = System.Drawing.Point(317, 395)
		self._button3.Name = "button3"
		self._button3.Size = System.Drawing.Size(49, 30)
		self._button3.TabIndex = 8
		self._button3.Text = "OK"
		self._button3.UseVisualStyleBackColor = False
		# 
		# button4
		# 
		self._button4.BackColor = System.Drawing.SystemColors.ScrollBar
		self._button4.Cursor = System.Windows.Forms.Cursors.WaitCursor
		self._button4.Font = System.Drawing.Font("MS UI Gothic", 10, System.Drawing.FontStyle.Bold, System.Drawing.GraphicsUnit.Point, 128, True)
		self._button4.ForeColor = System.Drawing.Color.Red
		self._button4.Location = System.Drawing.Point(372, 395)
		self._button4.Name = "button4"
		self._button4.Size = System.Drawing.Size(89, 30)
		self._button4.TabIndex = 8
		self._button4.Text = "CANCLE"
		self._button4.UseVisualStyleBackColor = False
		# 
		# label5
		# 
		self._label5.Location = System.Drawing.Point(1, 434)
		self._label5.Name = "label5"
		self._label5.Size = System.Drawing.Size(53, 19)
		self._label5.TabIndex = 9
		self._label5.Text = "@FVC"
		# 
		# MainForm
		# 
		self.ClientSize = System.Drawing.Size(482, 453)
		self.Controls.Add(self._label5)
		self.Controls.Add(self._button4)
		self.Controls.Add(self._button3)
		self.Controls.Add(self._groupBox4)
		self.Controls.Add(self._groupBox3)
		self.Controls.Add(self._groupBox2)
		self.Controls.Add(self._button2)
		self.Controls.Add(self._button1)
		self.Controls.Add(self._groupBox1)
		self.Name = "MainForm"
		self.Text = "PipeCreate"
		self._groupBox1.ResumeLayout(False)
		self._groupBox2.ResumeLayout(False)
		self._groupBox3.ResumeLayout(False)
		self._groupBox4.ResumeLayout(False)
		self._groupBox4.PerformLayout()
		self.ResumeLayout(False)


	def Label2Click(self, sender, e):
		pass


	def ComboBox1_SelectedIndexChanged(self, sender, e):
		TransactionManager.Instance.EnsureInTransaction(doc)



		TransactionManager.Instance.TransactionTaskDone()
		pass
	
	def ComboBox2_SelectedIndexChanged(self, sender, e):
		TransactionManager.Instance.EnsureInTransaction(doc)



		TransactionManager.Instance.TransactionTaskDone()
		pass	

	def ComboBox3_SelectedIndexChanged(self, sender, e):
		TransactionManager.Instance.EnsureInTransaction(doc)



		TransactionManager.Instance.TransactionTaskDone()
		pass


f = MainForm()
Application.Run(f)
# ----------------------------------------
pickPoints = Custom[pickPoints]()  # frozen; package Duynamo; from Duynamo. pick Point in current Workplane and retrive Revit Points in Millimeter unit
python_script_4 = Python()  # IronPython2; frozen; unwired: IN[0], IN[1]
# ---------- python_script_4.python (43 lines) ----------
"""Copyright by: vudinhduybm@gmail.com"""
import clr 
from System.Collections.Generic import *

clr.AddReference("ProtoGeometry")
from Autodesk.DesignScript.Geometry import *

clr.AddReference('RevitAPI')
from Autodesk.Revit.DB.Events import*

clr.AddReference('RevitAPIUI')
from Autodesk.Revit.UI import TaskDialog

clr.AddReference("RevitServices")
import RevitServices
from RevitServices.Persistence import DocumentManager

doc = DocumentManager.Instance.CurrentDBDocument
view = doc.ActiveView
uidoc = DocumentManager.Instance.CurrentUIApplication.ActiveUIDocument

x=True
dypoint = []
rpointM = []
rpointI = []
counter=0
msg = 'Pick Points on current Workplane in order, hit ESC when finished.'

TaskDialog.Show("Duynamo", msg)

while x == True:
	try:
		pt=uidoc.Selection.PickPoint(UnwrapElement(IN[0]))
		rpM=Point.ByCoordinates(pt.X*304.8,pt.Y*304.8,pt.Z*304.8)# don vi do mac dinh trong revitAPI la Inch, 1in=304.8mm
		rpI=Point.ByCoordinates(pt.X,pt.Y,pt.Z)
		counter=+1
		dypoint.append(pt)
		rpointM.append(rpM)
		rpointI.append(rpI)
	except:
		x=False

OUT=(dypoint,rpointM,rpointI)
# ----------------------------------------
boolean_3 = BoolSelector(true)
number = DoubleInput(500)
code_block = CodeBlock { "通気"; }
python_script_5 = Python(IN[0]=boolean_3, IN[1]=number, IN[2]=code_block)  # IronPython2
# ---------- python_script_5.python (64 lines) ----------
"""Copyright by: vudinhduybm@gmail.com"""
import clr 
import sys 
import System   
clr.AddReference("ProtoGeometry")
from Autodesk.DesignScript.Geometry import *

clr.AddReference("RevitAPI") 
from Autodesk.Revit.DB import*
from Autodesk.Revit.DB.Structure import*

clr.AddReference("RevitAPIUI") 
from Autodesk.Revit.UI import*

clr.AddReference("System") 
from System.Collections.Generic import List

clr.AddReference("RevitNodes")
import Revit
clr.ImportExtensions(Revit.Elements)
clr.ImportExtensions(Revit.GeometryConversion)

clr.AddReference("RevitServices")
import RevitServices
from RevitServices.Persistence import DocumentManager
from RevitServices.Transactions import TransactionManager

#Current doc/app/ui
doc = DocumentManager.Instance.CurrentDBDocument
uiapp = DocumentManager.Instance.CurrentUIApplication
app = uiapp.Application
uidoc = DocumentManager.Instance.CurrentUIApplication.ActiveUIDocument
view = doc.ActiveView

diameterIN = UnwrapElement(IN[1])
inSystemName = UnwrapElement(IN[2])

categories = [BuiltInCategory.OST_PipeCurves]
categoriesFilter = []
for c in categories:
    collector = FilteredElementCollector(doc).OfCategory(c).WhereElementIsNotElementType()
    categoriesFilter.append(collector)
flat_categoriesFilter = [item for sublist in categoriesFilter for item in sublist]
IDS = List[ElementId]()
for i in flat_categoriesFilter:
	IDS.Add(i.Id)

desPipes = []

paramFilter1 = ParameterValueProvider(ElementId(BuiltInParameter.RBS_PIPING_SYSTEM_TYPE_PARAM))
reason1 = FilterStringEquals()
fRule = FilterStringRule(paramFilter1,reason1, inSystemName)
filter1 = ElementParameterFilter(fRule)

i_Check = IN[1]/304.8
paramFilter2 = ParameterValueProvider(ElementId(BuiltInParameter.RBS_PIPE_DIAMETER_PARAM))
reason2 = FilterNumericEquals()
reason3 = FilterNumericGreaterOrEqual()
fRule2 = FilterDoubleRule(paramFilter2,reason2,i_Check,0.02)
filter2 = ElementParameterFilter(fRule2)
combineFilter = LogicalAndFilter(filter1 , filter2)
desPipes = FilteredElementCollector(doc, IDS).WherePasses(filter2).WhereElementIsNotElementType().ToElements()

OUT = desPipes
# ----------------------------------------
python_script_6 = Python()  # IronPython2; unwired: IN[0]
# ---------- python_script_6.python (46 lines) ----------
"""Copyright by: vudinhduybm@gmail.com"""
import clr 
import sys 
import System   
clr.AddReference("ProtoGeometry")
from Autodesk.DesignScript.Geometry import *

clr.AddReference("RevitAPI") 
from Autodesk.Revit.DB import*
from Autodesk.Revit.DB.Structure import*

clr.AddReference("RevitAPIUI") 
from Autodesk.Revit.UI import*

clr.AddReference("System") 
from System.Collections.Generic import List

clr.AddReference("RevitNodes")
import Revit
clr.ImportExtensions(Revit.Elements)
clr.ImportExtensions(Revit.GeometryConversion)

clr.AddReference("RevitServices")
import RevitServices
from RevitServices.Persistence import DocumentManager
from RevitServices.Transactions import TransactionManager

#Current doc/app/ui
doc = DocumentManager.Instance.CurrentDBDocument
uiapp = DocumentManager.Instance.CurrentUIApplication
app = uiapp.Application
uidoc = DocumentManager.Instance.CurrentUIApplication.ActiveUIDocument
view = doc.ActiveView

#Preparing input from dynamo to revit
element = UnwrapElement(IN[0])

#Do some action in a Transaction
TransactionManager.Instance.EnsureInTransaction(doc)
"""Now, You Can Code """



TransactionManager.Instance.TransactionTaskDone()

OUT = element
# ----------------------------------------
python_script_7 = Python()  # IronPython2; unwired: IN[0]
# ---------- python_script_7.python (47 lines) ----------
"""Copyright by: vudinhduybm@gmail.com"""
import clr 
import sys 
import System   
clr.AddReference("ProtoGeometry")
from Autodesk.DesignScript.Geometry import *

clr.AddReference("RevitAPI") 
from Autodesk.Revit.DB import*
from Autodesk.Revit.DB.Structure import*

clr.AddReference("RevitAPIUI") 
from Autodesk.Revit.UI import*

clr.AddReference("System") 
from System.Collections.Generic import List

clr.AddReference("RevitNodes")
import Revit
clr.ImportExtensions(Revit.Elements)
clr.ImportExtensions(Revit.GeometryConversion)

clr.AddReference("RevitServices")
import RevitServices
from RevitServices.Persistence import DocumentManager
from RevitServices.Transactions import TransactionManager

#Current doc/app/ui
doc = DocumentManager.Instance.CurrentDBDocument
uiapp = DocumentManager.Instance.CurrentUIApplication
app = uiapp.Application
uidoc = DocumentManager.Instance.CurrentUIApplication.ActiveUIDocument
view = doc.ActiveView

def getAllPipingSystems(doc):
	collector = FilteredElementCollector(doc).OfCategory(BuiltInCategory.OST_PipingSystem)
	pipingSystems = collector.ToElements()
	pipingSystemsName = []
	for system in pipingSystems:
		systemName = system.get_Parameter(BuiltInParameter.SYMBOL_NAME_PARAM).AsString()
		pipingSystemsName.append(systemName)
	return pipingSystemsName

lst = getAllPipingSystems(doc)
pipingSystemsCollector = [item for item in lst if item is not None]

OUT = pipingSystemsCollector
# ----------------------------------------
python_script_8 = Python()  # IronPython2; unwired: IN[0]
# ---------- python_script_8.python (156 lines) ----------
__title__ = "BIM3DM"  # Name of the button displayed in Revit UI
#========================================================================
import clr
clr.AddReference("System")   
import System
clr.AddReference('RevitAPI')
import Autodesk
from Autodesk.Revit.DB import*
from Autodesk.Revit.DB import Transaction, FilteredElementCollector
from pyrevit import revit, forms
from System.Collections.Generic import List
from pyrevit import revit, DB, UI, HOST_APP, forms


clr.AddReference('RevitAPIUI')
from Autodesk.Revit.UI import*
# from  Autodesk.Revit.UI.Selection import*

clr.AddReference("RevitServices")
import RevitServices
from RevitServices.Persistence import DocumentManager
from RevitServices.Transactions import TransactionManager

import math 
from System.Collections.Generic import *
clr.AddReference("ProtoGeometry")
from Autodesk.DesignScript.Geometry import *

clr.AddReference('RevitAPI')
import Autodesk
from Autodesk.Revit.DB import *
from Autodesk.Revit.DB.Structure import *

clr.AddReference('RevitAPIUI')
from Autodesk.Revit.UI import*
from  Autodesk.Revit.UI.Selection import*

clr.AddReference("RevitNodes")
import Revit
clr.ImportExtensions(Revit.Elements)
clr.ImportExtensions(Revit.GeometryConversion)

clr.AddReference("RevitServices")
import RevitServices
from RevitServices.Persistence import DocumentManager
from RevitServices.Transactions import TransactionManager
from Autodesk.DesignScript.Geometry import Point

from rpw.ui.forms import (FlexForm, Label, ComboBox, Separator, Button, TextBox)
from collections import OrderedDict
from pyrevit.framework import List
from Autodesk.Revit import Exceptions
import sys

#========================================================================
from pyrevit import forms
#========================================================================
doc = __revit__.ActiveUIDocument.Document # Document class from RevitAPI that represents project.
uidoc = __revit__.ActiveUIDocument # UIDocument class from RevitAPI that represents Revit project opened in the Revit UI.
app = __revit__.Application # Represents the Autodesk Revit Application, providing.
view = revit.active_view
#########################################################################
class SelectionFilter(ISelectionFilter):
    def __init__(self, ctgName1):
        self.ctgName1 = ctgName1

    def AllowElement(self, element):
        if element.Category.Name == self.ctgName1:
            return True
        else:
            return False
def addTextToString(content, add_text, index, after_number):
    """
    Add a string (add_text) at a specific position (index_content) in the given string (content).
    """
    index_content = int(index) - 1
    if index_content < 0 or index_content > len(content):
        # If index_content is invalid, simply return the original string
        return content
    # Add the new string at the specific position
    oldText = content[index_content+1:]
    result = content[:index_content+1] + add_text + after_number + oldText
    return result

#########################################################################
ele = SelectionFilter("Text Notes")
elSelectAll = uidoc.Selection.PickElementsByRectangle(ele,"Selects")
#########################################################################


txt_types = FilteredElementCollector(doc).OfClass(TextNoteType)
text_style_dict= {txt_t.get_Parameter(BuiltInParameter.SYMBOL_NAME_PARAM).AsString(): txt_t for txt_t in txt_types}

textNote = elSelectAll[0]
# Get the Element Type of the Text Note
textNoteType = doc.GetElement(textNote.GetTypeId())
# Get the Type Name parameter by BuiltInParameter
typeParameter = textNoteType.get_Parameter(BuiltInParameter.ALL_MODEL_TYPE_NAME)
typeName = typeParameter.AsString()

content = elSelectAll[0].Text

components = [
    Label("Pick Text Style:"),
    ComboBox(name="textstyle_combobox", options=text_style_dict,default=typeName),
    Label("Text Index (after of characters):"),
    TextBox(name="text_index", Text=str(len(content)-1)),
    Label("Prefix Character:"),
    TextBox(name="prefix_character", Text=""),
    Label("Middle Character:"),
    TextBox(name="middle_character", Text=""),
    Label("Begin Number:"),
    TextBox(name="number", Text="1"),

    Label("After Number:"),
    TextBox(name="after_number", Text=""),

    Label("Suffix Character:"),
    TextBox(name="suffix_character", Text=""),
    Button("Select")
    ]

form = FlexForm("Select", components)
ok = form.show()
if ok:
    # assign chosen values
    text_style = form.values["textstyle_combobox"]

    text_index = form.values["text_index"]
    prefix_character = form.values["prefix_character"]
    middle_character = form.values["middle_character"]
    number = int(form.values["number"])
    suffix_character = form.values["suffix_character"]
    after_number = form.values["after_number"]
else:
    sys.exit()


condition = True
n = number
try:
    while condition:
        with Transaction(doc, __title__) as t:
            t.Start("Create Grid")
            pickPoint = uidoc.Selection.PickPoint("Select Point")
            textAdd =  str(middle_character) + str(n) 
            
            textWithoutNewline= str(prefix_character) +  addTextToString(content, textAdd, int(text_index), after_number) +  str(suffix_character)
            
            textWithoutNewline = textWithoutNewline.replace("\r", "")
            text_note = DB.TextNote.Create(doc, view.Id, pickPoint, textWithoutNewline , text_style.Id)
            n = n + 1
            t.Commit()
except Exception as e:
    condition = False
    str(e)
# ----------------------------------------
